# Grasshopper definition revitgeometrytest.gh (Grasshopper 1.0.7)

panel = Panel("""(-57.937278237577, 33.5150870273695, 3.93700787401575)
(-36.939902909493, 33.5150870273694, 3.93700787401575)
(-36.939902909493, 34.171255006372, 3.93700787401575)
(-57.937278237577, 34.1712550063721, 3.93700787401575)

(-57.937278237577, 33.5150870273695, 0)
(-36.939902909493, 33.5150870273694, 0)
(-57.937278237577, 33.5150870273695, 3.93700787401575)
(-57.937278237577, 33.5150870273695, 0)

(-36.939902909493, 33.5150870273694, 0)
(-57.937278237577, 34.1712550063721, 0)
(-36.939902909493, 34.171255006372, 3.93700787401575)
(-36.939902909493, 34.171255006372, 0)""")
python = GhPythonScript(str=panel)  # -> out, a, pt
# ---------- python: Python ----------
__author__ = "Qiang"
__version__ = "2022.11.16"

import rhinoscriptsyntax as rs
import re
#a=str.split(",")
#pt = rs.AddPoint(float(a[0]), float(a[1]), float(a[2]))

findall = re.findall(r'[(](.*?)[)]', str)
print(findall)
pt=[]
for items in findall:
    temp=items.split(",")
    pt.append(rs.AddPoint(float(temp[0]), float(temp[1]), float(temp[2])))
# ---------- end python ----------
python_2 = GhPythonScript(str="(-57.937278237577, 33.8431710168708, 0)")  # -> out, a, pt; same code as python
